# Dynamo custom node GeometryCentroid_Elevation.dyf (Dynamo 2.3.0.5885)
# category: KennyStruct Nodes.Geometry
# packages: Clockwork for Dynamo 2.x 2.3.0

Geometry = Input(Geometry_: var[]..[])
boundingBox = Geometry.BoundingBox(geometry=Geometry)
properties = Custom[BoundingBox.Properties](boundingBox=boundingBox)  # package Clockwork for Dynamo 2.x; Retrieves the centroid, width, depth and height of a given bounding box
CentroidPoints = Output(properties.Centroid)  # "CentroidPoints: Points"; Centroid Points
Z = Point.Z(point=properties.Centroid)
Elevation = Output(Z)  # "Elevation: double"; Geometry elevation in the Z-axis
