# Dynamo custom node GetFloorSurfaceandCurves.dyf (Dynamo 2.3.1.11775)
# category: KennyStruct Nodes.Revit
# Get the top surface and outline curves of a Revit Floor

Element_Geometry = Input(Element_Geometry: Autodesk.DesignScript.Geometry.Solid)
bySolid = PolySurface.BySolid(solid=Element_Geometry)

# group: put polysurfaces into this
surfaces = PolySurface.Surfaces(polySurface=bySolid)
code_block = CodeBlock { 0.5; }
pointAtParameter = Surface.PointAtParameter(surface=surfaces, u=code_block, v=code_block)
Z = Point.Z(point=pointAtParameter)
sortByKey = List.SortByKey(list=surfaces, keys=Z)
reverse = List.Reverse(list=sortByKey.sorted_list)
firstItem = List.FirstItem(list=reverse)
perimeterCurves = Surface.PerimeterCurves(surface=firstItem)
lastItem = List.LastItem(list=reverse)
perimeterCurves_2 = Surface.PerimeterCurves(surface=lastItem)

Top_Surface = Output(firstItem)
Top_Curves = Output(perimeterCurves)
Bottom_Surface = Output(lastItem)
Bottom_Curves = Output(perimeterCurves_2)
Bottom_Surface_2 = Output(lastItem)  # "Bottom Surface"
Bottom_Curves_2 = Output(perimeterCurves_2)  # "Bottom Curves"
