# Dynamo custom node RemoveListOfStringsFromList.dyf (Dynamo 2.3.0.5885)
# category: KennyStruct Nodes.List
# Remove lists of unwanted strings in an existing list

list = Input(list: var)
string_from_object = FromObject(obj=list)
searchFor = Input(searchFor: string)
contains = String.Contains(str=string_from_object, searchFor=searchFor, lacing=CrossProduct)
boolean = BoolSelector(true)
contains_2 = List.Contains(list=contains@L3, item=boolean)
boolean_2 = BoolSelector(false)
allIndicesOf = List.AllIndicesOf(list=contains_2, item=boolean_2)
getItemAtIndex = List.GetItemAtIndex(list=list, index=allIndicesOf)
item = Output(getItemAtIndex)
