# Dynamo custom node SAT-Dynamo_Surface_Geometry.dyf (Dynamo 2.3.0.5885)
# category: KennyStruct Nodes.Revit
# Converts Revit geometry to dynamo geometry and extracts all the surfaces in the geometry

RevitElement = Input(RevitElement: Revit.Elements.Element)  # select revit model element
geometry = Element.Geometry(element=RevitElement)
flatten = List.Flatten(list=geometry)
string = StringInput("Surface")
removeIfNot = List.RemoveIfNot(list=flatten, type=string)
GeometrySurfaces = Output(removeIfNot)  # "GeometrySurfaces: var[]..[]"; All surfaces from the selected revit element geometry
