# Dynamo custom node SetRebarAsSolidUnobscured.dyf (Dynamo 2.3.1.11775)
# category: KennyStruct Nodes.Revit
# Set rebar as both solid and unobscured in current view
# packages: Structural Design 2021.1.22

rebar = Input(rebar: Revit.Elements.Element)
refresh = Input(refresh: bool = true)
code_block = CodeBlock { document1 = Revit.Document.Current; Revit.Document.ActiveView(document1); }
if_ = If(test=refresh, true=code_block.out1, false=code_block.out1)
boolean = BoolSelector(true)
setUnobscuredInView = StructuralDesign.Rebar.Create.SetUnobscuredInView(rebar=rebar, view=if_, unobscured=boolean)
setSolidInView = StructuralDesign.Rebar.Create.SetSolidInView(rebar=setUnobscuredInView, view=if_, solid=boolean)
Rebar = Output(setSolidInView)
