# Dynamo custom node SetRebarHookAndShape.dyf (Dynamo 2.3.1.11775)
# category: KennyStruct Nodes.Revit
# Set rebar shape and hook types

Rebar = Input(Rebar: Revit.Elements.Element)
RebarShape = Input(RebarShape: var[]..[])
HookType_Start = Input(HookType_Start: var[]..[])
HookType_End = Input(HookType_End: var[]..[])
code_block = CodeBlock(Shape=RebarShape, Hook1=HookType_Start, Hook2=HookType_End) { ["Shape", "Hook At Start", "Hook At End"]; [Shape,Hook1,Hook2]; }
setParameterByName = Element.SetParameterByName(element=Rebar, parameterName=code_block.out0, value=code_block.out1, lacing=Longest)
code_block_2 = CodeBlock { 1; }
takeItems = List.TakeItems(list=setParameterByName@L2, amount=code_block_2)
flatten = List.Flatten(list=takeItems)
Rebar_2 = Output(flatten)  # "Rebar"
