# Dynamo custom node SplitColumnsByLevels.dyf (Dynamo 2.3.0.5885)
# category: KennyStruct Nodes.Revit
# Split selected revit structural columns base on associated levels in the document
# packages: Data-Shapes 2021.2.92

code_block = CodeBlock { "Split Walls By Level"; "Finish"; "Cancel"; }
RunScript = Input(RunScript: bool)  # Choose if you want to run the script
code_block_2 = CodeBlock { "KS DynaNodes"; "Walls to split"; }
categories = Categories("OST_StructuralColumns")
selectmodelelements_data = Custom[SelectModelElements Data](InputName=code_block_2.out1, CategoryFilter=categories)  # package Data-Shapes; Creates a Revit element selection input for UI.MultipleInputForm++ . Check out www.data-shapes.net for more infos!
code_block_3 = CodeBlock { "Run Script"; }
boolean = BoolSelector(true)  # graph input
boolean_input = Custom[Boolean input](InputName=code_block_3, DefaultValue=boolean)  # package Data-Shapes; Creates a boolean input for UI.MultipleInputForm ++ . Check out www.data-shapes.net for more infos!
join = List.Join(list0=selectmodelelements_data, list1=boolean_input)
multipleinputform = Custom[MultipleInputForm ++](Description_optional=code_block.out0, Logo_optional=RunScript, ButtonText_optional=code_block.out1, Inputs=join, Toggle=RunScript, CancelButtonText_optional=code_block.out2)  # package Data-Shapes; Create a form with multiple inputs. see www.data-shapes.net for tutorials and infos!
code_block_4 = CodeBlock(x=multipleinputform.User_Inputs) { x[1]; x[0]; }
all_levels_py = Python()
# ---------- all_levels_py.python (26 lines) ----------
import clr

clr.AddReference('ProtoGeometry')
from Autodesk.DesignScript import Geometry as geom

clr.AddReference("RevitServices")
import RevitServices
from RevitServices.Persistence import DocumentManager
from RevitServices.Transactions import TransactionManager
doc =  DocumentManager.Instance.CurrentDBDocument
 
clr.AddReference("RevitNodes")
import Revit
clr.ImportExtensions(Revit.Elements)
clr.ImportExtensions(Revit.GeometryConversion)
 
clr.AddReference("RevitAPI")
from Autodesk.Revit.DB import *
 
def tolist(obj1):
    if hasattr(obj1,"__iter__"): return obj1
    else: return [obj1]

levels = FilteredElementCollector(doc).OfClass(Level).WhereElementIsNotElementType().ToElements()

OUT = levels
# ----------------------------------------
BaseOffset = Input(BaseOffset: var[]..[])  # Specify column base level offset
code_block_5 = CodeBlock(run=code_block_4.out0, columns=code_block_4.out1, levels=all_levels_py, offset=BaseOffset) { run; columns; levels; offset; }
columns_python_script = Python(IN[0]=code_block_5.run, IN[1]=code_block_5.columns, IN[2]=code_block_5.levels, IN[3]=code_block_5.offset)
# ---------- columns_python_script.python (132 lines) ----------
import clr

clr.AddReference('ProtoGeometry')
from Autodesk.DesignScript import Geometry as geom

clr.AddReference("RevitServices")
import RevitServices
from RevitServices.Persistence import DocumentManager
from RevitServices.Transactions import TransactionManager
doc =  DocumentManager.Instance.CurrentDBDocument
 
clr.AddReference("RevitNodes")
import Revit
clr.ImportExtensions(Revit.Elements)
clr.ImportExtensions(Revit.GeometryConversion)
 
clr.AddReference("RevitAPI")
from Autodesk.Revit.DB import *

# Convert to list if not list...
def tolist(obj1):
    if hasattr(obj1,"__iter__"): return obj1
    else: return [obj1]

# Gets the centreline of the column...
def GetColumnCentreline(e):	
	crv = None	
	fs = e.Symbol
	fm = fs.Family	
	if not fm.GetType() == DirectShape:
		if not fm.IsInPlace:
			if e.IsSlantedColumn:
				try:
					crv = e.Location.Curve.ToProtoType()
				except:
					return
			else:
				loc = e.Location.Point.ToPoint()
				
				bLev = (e.Document.GetElement(e.get_Parameter(BuiltInParameter.FAMILY_BASE_LEVEL_PARAM).AsElementId()).Elevation + e.get_Parameter(BuiltInParameter.FAMILY_BASE_LEVEL_OFFSET_PARAM).AsDouble()) * ft2mm
				tLev = (e.Document.GetElement(e.get_Parameter(BuiltInParameter.FAMILY_TOP_LEVEL_PARAM).AsElementId()).Elevation + e.get_Parameter(BuiltInParameter.FAMILY_TOP_LEVEL_OFFSET_PARAM).AsDouble()) * ft2mm
				
				crv = geom.Line.ByStartPointEndPoint(geom.Point.ByCoordinates(loc.X,loc.Y,bLev), geom.Point.ByCoordinates(loc.X,loc.Y,tLev))
	return crv

# Convert Level to DS Plane...
def LevelToPlane(l):
	pt = geom.Point.ByCoordinates(0,0,round(l.Elevation * ft2mm,0)+offset)
	n = geom.Vector.ZAxis()
	return geom.Plane.ByOriginNormal(pt,n)

# Get the nearest Level above in list of Levels to gien Elevation...
def NearestLevelAbove(elev,lvls):
	lvlAbv = None
	for l in lvls:
		if round(l.Elevation*ft2mm,0) > elev:
			lvlAbv = l
			break			
	return lvlAbv

# Get the nearest Level in list of Levels to gien Elevation...
def NearestLevel(elev, lvls):
	return min(lvls, key=lambda x:abs(round(x.Elevation*ft2mm,0)-elev))

# Calculates the location to split column with parameterised column length (between 0 & 1)...
def CalculateSplitParameter(col,lvls):
	# Switch out for mathematical method to speed up computation...
	# abs(NewColBaseElevation-LevelAboveElevation)/NewCol length should give split parameter...
	if col:
		crv = GetColumnCentreline(col)
		elev = round(crv.StartPoint.Z,0)
		l = NearestLevelAbove(elev,lvls)		
		
		x = geom.Geometry.Intersect(crv,LevelToPlane(l))
		if x:
			x = x[0]
			return geom.Curve.ParameterAtPoint(crv,x)
				
	return None

# IN Variables...
run = tolist(IN[0])[0]
columns = tolist(UnwrapElement(IN[1]))
lvls = tolist(UnwrapElement(IN[2]))
offset = 0
if IN[3]:
	offset = tolist(IN[3])[0]


# OUT Variables...
outList = []

# Main Body...
if run:
	ft2mm = 304.8
	lvls = sorted(lvls, key=lambda x: x.Elevation)
	
	# Start Transaction to allow for Document modification...
	TransactionManager.Instance.EnsureInTransaction(doc)
	for c in columns:
		# Ensure only Structural Columns are used (modify if Arch Columns category is required)
		if c.Category.Name == Category.GetCategory(doc,BuiltInCategory.OST_StructuralColumns).Name:
			arr = []
			arr.append(c)
			newCol = None
			crv = GetColumnCentreline(c)
			
			bLvlIndex = lvls.index(NearestLevel(crv.StartPoint.Z,lvls))
			tLvlIndex = lvls.index(NearestLevel(crv.EndPoint.Z,lvls))
			
			i = bLvlIndex
			while i <= tLvlIndex:
				try:	
					if not newCol:
						p = CalculateSplitParameter(c,lvls)
						newCol = doc.GetElement(c.Split(p))
						arr.append(newCol)			
					else:
						p = CalculateSplitParameter(newCol,lvls)
						newCol = doc.GetElement(newCol.Split(p))
						arr.append(newCol)
				except Exception, ex:
					arr.append(ex.message)
				i = i+1		
			outList.append(arr)
		else:
			outList.append("Element is not of Category Structural Column")			
		
	TransactionManager.Instance.TransactionTaskDone()
	OUT = outList
else:
	OUT = "Please set Run to True"
# ----------------------------------------
SplittedColumns = Output(columns_python_script)  # Spltted Column elements grouped by levels
WasRun = Output(multipleinputform.Was_Run)  # Specifies if script was run
WasCancelled = Output(multipleinputform.Was_Cancelled)  # Specifies if script was cancelled
code_block_6 = CodeBlock {  }
