# Dynamo custom node SplitSelectedWallsByLevels.dyf (Dynamo 2.3.0.5885)
# category: KennyStruct Nodes.Revit
# Split selected walls by project levels
# packages: Data-Shapes 2021.2.92

RunScript = Input(RunScript: bool)  # Specify if you want to run this script using a Boolean node
code_block = CodeBlock { "Split Walls By Level"; "Finish"; "Cancel"; }
code_block_2 = CodeBlock { "Walls to split"; }
string = StringInput("Select Walls to Split")
categories = Categories("OST_Walls")
selectmodelelements_data = Custom[SelectModelElements Data](InputName=code_block_2, ButtonText=string, CategoryFilter=categories)  # package Data-Shapes; Creates a Revit element selection input for UI.MultipleInputForm++ . Check out www.data-shapes.net for more infos!
join = List.Join(list0=selectmodelelements_data)
multipleinputform = Custom[MultipleInputForm ++](Description_optional=code_block.out0, Logo_optional=RunScript, ButtonText_optional=code_block.out1, Inputs=join, Toggle=RunScript, CancelButtonText_optional=code_block.out2)  # package Data-Shapes; Create a form with multiple inputs. see www.data-shapes.net for tutorials and infos!
flatten = List.Flatten(list=multipleinputform.User_Inputs)
code_block_3 = CodeBlock(Run=RunScript, Walls=flatten) { Run; _Walls; }
wall_python_script = Python(IN[0]=code_block_3.Run, IN[1]=code_block_3._Walls)
# ---------- wall_python_script.python (105 lines) ----------
import clr
 
clr.AddReference("RevitServices")
import RevitServices
from RevitServices.Persistence import DocumentManager
from RevitServices.Transactions import TransactionManager
doc =  DocumentManager.Instance.CurrentDBDocument
 
clr.AddReference("RevitNodes")
import Revit
clr.ImportExtensions(Revit.Elements)
clr.ImportExtensions(Revit.GeometryConversion)
 
clr.AddReference("RevitAPI")
from Autodesk.Revit.DB import *
 
import System
from System.Collections.Generic import *
 
############## Definitions Start ##############
# Convert to List if singleton...
def tolist(obj1):
    if hasattr(obj1,"__iter__"): return obj1
    else: return [obj1]
     
# Returns the index of the found level given a Level and a list of Levels...
def FindLevelIndex(levels, lev):
    ind = None
    i = 0
    for l in levels:
        if l.Id.ToString() == lev.Id.ToString():
            ind = i
        i = i+1
    return ind
 
# Copy the original wall and set it's levels using the Built-In Parameters for the Base and Top Constraints...
def CopyWallByLevel(wall, b, t):
    wallOut = None
    try:
        # Copy the Original Wall with a transformation vector of 0,0,0...
        w = ElementTransformUtils.CopyElement(doc,wall.Id,XYZ(0,0,0))
        # Since the CopyElements method returns the ElementId of the new wall we need to get this Element from the Document...
        w = doc.GetElement(w[0])
        # Update the Base and Top constraints Parameters using the Built-In Parameters.
        # Note: I have explicitly chosen the Overload as I was getting flaky behaviour where the wrong overload was being used...
        p = w.get_Parameter(BuiltInParameter.WALL_BASE_CONSTRAINT)
        p.Set.Overloads.Functions[2](b.Id)
        p = w.get_Parameter(BuiltInParameter.WALL_HEIGHT_TYPE)
        p.Set.Overloads.Functions[2](t.Id)
        wallOut = w.ToDSType(True)
    # Write out any exceptions...
    except Exception, e:
        wallOut = e.message
    # Return new wall..
    return wallOut    
############## Definitions End ##############
 
# IN-Variables...
run = tolist(IN[0])[0]
walls = tolist(UnwrapElement(IN[1]))
 
# OUT-Variables...
outList = []
 
# Main Script...
# Test if user has selected Run as True...
if run:
    # Get All Levels in the Document and cast to .net List...
    levels = list([l for l in FilteredElementCollector(doc).OfClass(Level).ToElements()])
    # Sort Levels by Elevation using a lamda expression...
    levels.sort(key=lambda x: x.Elevation, reverse=False)
     
    # Start a new Transaction ready for modifying the Document...
    TransactionManager.Instance.EnsureInTransaction(doc)
    for w in walls:
        arr = []
        # Check if the Element is a Wall...
        if w.GetType() == Wall:
            # Get Base and Top Constraints as Levels...
            p = w.get_Parameter(BuiltInParameter.WALL_BASE_CONSTRAINT)
            base = doc.GetElement(p.AsElementId())
            p = w.get_Parameter(BuiltInParameter.WALL_HEIGHT_TYPE)
            top = doc.GetElement(p.AsElementId())
            
            # Test whether walls Base and Top levels are NOT the same, if they are we will skip this wall, if they are not then we will get the Index of the Level in the sorted list of Levels we collected earlier for both the Base and Top of the wall...
            if not base.Id.IntegerValue == top.Id.IntegerValue:
                # Note: we are setting the bounds of the Loop below with the Indices of the found Levels so we will only loop through the Levels in between the Base and Top Levels...            
                i = FindLevelIndex(levels,base)
                j = FindLevelIndex(levels,top)
                
                # Loop through the Levels between the Base and Top Levels copying the original wall for each iteration and stepping up one Level...
                while i < j:
                    wCopy = CopyWallByLevel(w,levels[i], levels[i+1])
                    arr.append(wCopy)    
                    i = i+1
                outList.append(arr)
                # Delete original Wall as this has now been split by Level...
                doc.Delete(w.Id)
    # End the Transaction...
    TransactionManager.Instance.TransactionTaskDone()
    # Return the new Walls...
    OUT = outList
# Return if user has not set input Run to True...
else:
    OUT = "Please Set Run to True"
# ----------------------------------------
count = List.Count(list=wall_python_script@L2)
code_block_4 = CodeBlock(last=count) { last-1; }
removeItemAtIndex = List.RemoveItemAtIndex(list=wall_python_script@L2, indices=code_block_4@L1)
wall_top_offset_parameter = StringInput("Top Offset")
wall_top_offset = DoubleInput(0)
setParameterByName = Element.SetParameterByName(element=removeItemAtIndex, parameterName=wall_top_offset_parameter, value=wall_top_offset)
SplittedWalls = Output(setParameterByName)  # Spltted wall elements grouped by levels
code_block_5 = CodeBlock { 1; }
dropItems = List.DropItems(list=wall_python_script@L2, amount=code_block_5)
wall_top_offset_parameter_2 = StringInput("Base Offset")
wall_top_offset_2 = DoubleInput(0)
setParameterByName_2 = Element.SetParameterByName(element=dropItems, parameterName=wall_top_offset_parameter_2, value=wall_top_offset_2)
WasRun = Output(multipleinputform.Was_Run)  # Specifies if the script was run
WasCancelled = Output(multipleinputform.Was_Cancelled)  # Specifies if the script was cancelled
